# Dynamo graph example-1.3.4.dyn (Dynamo 1.3.4.6666)

number_slider = DoubleSlider(50, range=0..100 step 0.1)
number_slider_2 = DoubleSlider(25, range=0..100 step 0.1)
mul = number_slider * number_slider_2
watch = Watch(mul)
div = mul / number_slider_2
watch_2 = Watch(div)
