# Grasshopper definition example.gh (Grasshopper 1.0.7)

number_slider = Slider(0.25, range=0..1)
multiplication = Multiplication(A=Slider(0.25, range=0..1), B=number_slider)
division = Division(A=multiplication, B=number_slider)
panel = Panel(multiplication)
panel_2 = Panel(division)
